% Requirement links of piCtrl.slx (R2018a)

model links to throttleReqs.slreqx#6: pi_ctrl_1: Must implement standard proporti...
model links to throttleReqs.slreqx#7: pi_ctrl_2: Proportional and integral gains ...
model links to throttleReqs.slreqx#8: pi_ctrl_3: Maximum value of integral state ...