% Requirement links of pwmCnv.slx (R2018a)

model links to throttleReqs.slreqx#10: pwm_1: Duty cycle must be proportional ...
model links to throttleReqs.slreqx#11: pwm_2: PWM torque should act in positiv...
model links to throttleReqs.slreqx#12: pwm_3: PWM torque should act in negativ...
model links to throttleReqs.slreqx#13: pwm_4: Duty cycle must be in range from 0 to 1.